# Grasshopper definition atI.gh (Grasshopper 1.0.7)
# plug-ins: GhPolyhedra, LunchBox

polyhedra_categories = PolyhedraCategories()
panel = Panel(polyhedra_categories)
panel_2 = Panel("C:\Users\Tim Chen\Documents\GitHub\Weaving\atI\atI_edge.csv")
item = ListItem(List=polyhedra_categories, Index=Slider(39, range=0..100), Wrap=True)
file = ReadFile(File="C:\Users\Tim Chen\Documents\GitHub\Weaving\atI\atI_srf.csv", PerLineParse=True)
file_2 = ReadFile(File="C:\Users\Tim Chen\Documents\GitHub\Weaving\atI\atI_p.csv", PerLineParse=True)
polyhedra_names = PolyhedraNames(Category=item)
file_3 = ReadFile(File=panel_2, PerLineParse=True)
csv = ReadCSV(CSVString=file, Delimiter=",")  # -> Headers, Values
csv_2 = ReadCSV(CSVString=file_2, Delimiter=",")  # -> Headers, Values
csv_3 = ReadCSV(CSVString=file_3, Delimiter=",")  # -> Headers, Values
item_2 = ListItem(List=polyhedra_names, Index=Slider(29, range=0..100), Wrap=True)
branch = TreeBranch(Tree=csv_2.Values, Path=Slider(1, range=0..100), MaintainPaths=True)
branch_2 = TreeBranch(Tree=csv_2.Values, Path=Slider(0, range=0..100), MaintainPaths=True)
flip = FlipMatrix(Data=csv.Values)
branch_3 = TreeBranch(Tree=csv_2.Values, Path=Slider(2, range=0..100), MaintainPaths=True)
branch_4 = TreeBranch(Tree=csv_3.Values, Path=Slider(1, range=0..100), MaintainPaths=True)
branch_5 = TreeBranch(Tree=csv_3.Values, Path=Slider(0, range=0..100), MaintainPaths=True)
panel_3 = Panel(item_2)
polyhedron = Polyhedron(Name=item_2, Plane=PlaneXY(0, 0, 0), Scale=1)  # -> Curves, Meshes, Solid
pt = ConstructPoint(XCoordinate=branch_2, YCoordinate=branch, ZCoordinate=branch_3)
pt_2 = Point(Point(0, 0, 0))
crv = Curve(polyhedron.Curves)
explode = Explode(Curve=crv, Recursive=True)  # -> Segments, Vertices
ln = Line(StartPoint=pt_2, EndPoint=pt)
python = GhPythonScript(s=flip, P=pt)  # -> plList; inputs s: tree, P: list
# ---------- python: Python ----------
__author__ = "Tim Chen"
__version__ = "2019.09.24"

import rhinoscriptsyntax as rs

plList=[]
for si in s.Branches:
    si=list(si)
    si.append(si[0])
    pl=[rs.AddPoint(P[int(sii)]) for sii in si  if sii is not '']
    plList.append(rs.AddPolyline(pl))
# ---------- end python ----------
item_3 = ListItem(List=pt, Index=branch_5, Wrap=True)
pt_3 = Point(Point(3, 5, 6))
item_4 = ListItem(List=pt, Index=branch_4, Wrap=True)
len = Length(Curve=ln)
lng = ListLength(List=explode.Segments)
eval = EvaluateLength(Curve=explode.Segments, Length=Slider(0.5, range=0..1), Normalized=True)  # -> Point, Tangent, Parameter
crv_2 = Curve(python)
srf = Surface(python)
ln_2 = Line(StartPoint=item_3, EndPoint=item_4)
avr = Average(Input=len)
larger = LargerThan(FirstNumber=lng, SecondNumber=Slider(3, range=0..10))  # -> LargerThan, OrEqualTo
panel_4 = Panel(len)
not = GateNot(A=larger.LargerThan)
cull = CullPattern(List=graft(crv), CullPattern=not)
srf_2 = Surface(crv)
panel_5 = Panel(lng)
